% Simulink data dictionary wrapper2.sldd

Actor = Simulink.Bus()
  ActorID: double
  Position: double[1 3], Unit="m"
  Velocity: double[1 3], Unit="m/s"
  Roll: double, Unit="deg"
  Pitch: double, Unit="deg"
  Yaw: double, Unit="deg"
  AngularVelocity: double[1 3], Unit="deg/s"

Actors = Simulink.Bus()
  NumActors: double
  Time: double, Unit="sec"
  Actors: Bus: Actor

EgoVehicle = Simulink.Bus()
  ActorID: double
  Position: double[1 3], Unit="m"
  Velocity: double[1 3], Unit="m/s"
  Roll: double, Unit="deg"
  Pitch: double, Unit="deg"
  Yaw: double, Unit="deg"
  AngularVelocity: double[1 3], Unit="deg/s"